# Dynamo graph Formwork 1.dyn (Dynamo 1.3.3.4111)

select_model_element = DSModelElementSelection()  # 1 picked in the model
getLocation = Element.GetLocation(select_model_element)
type = archilab.Revit.Elements.Elements.Type(select_model_element)
code_block = CodeBlock { "Width"; }
getParameterValueByName = Element.GetParameterValueByName(element=type, parameterName=code_block)
code_block_2 = CodeBlock(a=getParameterValueByName) { a/2; }
offset = Curve.Offset(curve=getLocation, distance=code_block_2)
code_block_3 = CodeBlock(a=code_block_2) { -a; }
offset_2 = Curve.Offset(curve=getLocation, distance=code_block_3)
create = List.Create(offset, offset_2)
ZAxis = Vector.ZAxis()
네모도 = DoubleInput(50)
translate = Geometry.Translate(geometry=create, direction=ZAxis, distance=네모도)
ZAxis_2 = Vector.ZAxis()
n1단 = DoubleInput(1200)  # "1단"
translate_2 = Geometry.Translate(geometry=translate, direction=ZAxis_2, distance=n1단)
ZAxis_3 = Vector.ZAxis()
n2단 = DoubleInput(1200)  # "2단"
translate_3 = Geometry.Translate(geometry=translate_2, direction=ZAxis_3, distance=n2단)
create_2 = List.Create(translate_2, translate, translate_3)
byCurve = ModelCurve.ByCurve(create_2)
